# Grasshopper definition 01_Standard Railing.gh (Grasshopper 1.0.7)
# plug-ins: Pufferfish, Human

# Group Number Control
number_slider = Slider(15, range=0..99)
# Railings Path
# Railings Path Reverse
# Railings Offset
# Bake
number_slider_2 = Slider(100, range=0..100)
# Layer
panel = Panel("Right Atrium::Railings::")
button = Button()
crv = Curve([<curve referenced from the Rhino model> x4])
multiplication = Multiplication(A=number_slider, B=10)
# Top Railing Height
# Top Railing Width
# Top Railing Thickness
addition = Addition(A="500", B=multiplication)
# Baluster Thickness
# Baluster Width
# Baluster Distance
dispatch = Dispatch(List=crv, DispatchPattern=Toggle(False))  # -> ListA, ListB
brep = Brep([<brep referenced from the Rhino model> x28])
flip = FlipCurve(Curve=dispatch.ListB)  # -> Curve, Flag
mesh = MeshBrep(
    Brep=brep,
    Settings={GridMaxCount=0, GridMinCount=16, JaggedSeams=False, MaxEdgeLength=0, MinEdgeLength=0.0001, MinTolerance=0, Refine=True, RefineAngle=0, RelativeTolerance=0.65, SimplePlanes=True, Tolerance=0})
crv_2 = Curve([dispatch.ListA, flip.Curve])
# Glass Height
number_slider_3 = Slider(1200, range=0..10000)
number_slider_4 = Slider(1100, range=0..10000)
offset = OffsetCurve(Curve=crv_2, Distance=number_slider_2, Plane=PlaneXY(0, 0, 0), Corners=1)

number_slider_5 = Slider(20, range=0..100)
division = Division(A=number_slider_5, B=2)
subtraction = Subtraction(A=number_slider_4, B=division)
division_2 = Division(A=Slider(60, range=0..100), B=2)
subtraction_2 = Subtraction(A=number_slider_4, B=number_slider_5)
Z = UnitZ(Factor=subtraction_2)
move = Move(Geometry=offset, Motion=Z)  # -> Geometry, Transform
Z_2 = UnitZ(Factor=number_slider_5)
extr = Extrude(Base=move.Geometry, Direction=Z_2)
offsrf = OffsetSurface(Surface=extr, Distance=division_2, BothSides=True, CreateSolid=True)
concat = Concatenate(FragmentA=panel, FragmentB="Hand Rail")
createatts = CreateAttributes(LayerName=concat, GroupIndices=expr("x+1", addition), enableFullPath=True)
bake = BakeGeometry(Bake=button, Geometry=offsrf, Attributes=createatts, DeleteOldBakes=False, PreserveTrees=False)

pt = Point(<point referenced from the Rhino model>)  # disabled
brep_2 = Brep(<brep referenced from the Rhino model>)  # disabled
pt_2 = Point(<point referenced from the Rhino model>)
brep_3 = Brep(<brep referenced from the Rhino model>)
pt_3 = Point(<point referenced from the Rhino model>)
brep_4 = Brep(<brep referenced from the Rhino model>)
panel_2 = Panel("Baluster Light")  # disabled
concat_2 = Concatenate(FragmentA=panel, FragmentB=panel_2)  # disabled
concat_3 = Concatenate(FragmentA=panel, FragmentB="Baluster")  # disabled
createatts_2 = CreateAttributes(LayerName=concat_2, GroupIndices=expr("x+4", addition), enableFullPath=True)  # disabled
createatts_3 = CreateAttributes(LayerName=concat_3, GroupIndices=expr("x+3", addition), enableFullPath=True)  # disabled

division_3 = Division(A=Slider(20, range=0..100), B=2)
division_4 = Division(A=Slider(30, range=0..100), B=2)
divlength = DivideLength(Curve=offset, Length=Slider(1600, range=0..10000))  # -> Points, Tangents, Parameters
subtraction_3 = Subtraction(A=number_slider_4, B=number_slider_5)
neg = Negative(Value=division_3)
neg_2 = Negative(Value=division_4)
hframe = HorizontalFrame(Curve=offset, Parameter=divlength.Parameters)
dom = ConstructDomain(DomainStart=neg, DomainEnd=division_3)
dom_2 = ConstructDomain(DomainStart=neg_2, DomainEnd=division_4)
Z_3 = UnitZ(Factor=subtraction_3)
rectangle = Rectangle(Plane=hframe, XSize=dom, YSize=dom_2, Radius=0)  # -> Rectangle, Length
extr_2 = Extrude(Base=rectangle.Rectangle, Direction=Z_3)
cap = CapHoles(Brep=extr_2)
concat_4 = Concatenate(FragmentA=panel, FragmentB="Baluster")
createatts_4 = CreateAttributes(LayerName=concat_4, GroupIndices=addition, enableFullPath=True)

culln = CullNth(List=hframe, CullFrequency=2)
orient = Orient(Geometry=brep_2, Source=pt, Target=culln)  # -> Geometry, Transform; disabled
orient_2 = Orient(Geometry=brep_3, Source=pt_2, Target=hframe)  # -> Geometry, Transform
orient_3 = Orient(Geometry=brep_4, Source=pt_3, Target=culln)  # -> Geometry, Transform
bake_2 = BakeGeometry(Bake=button, Geometry=orient.Geometry, Attributes=createatts_2, DeleteOldBakes=False, PreserveTrees=False)  # disabled
bake_3 = BakeGeometry(Bake=button, Geometry=orient_3.Geometry, Attributes=createatts_3, DeleteOldBakes=False, PreserveTrees=False)  # disabled

bake_4 = BakeGeometry(Bake=button, Geometry=orient_2.Geometry, Attributes=createatts_4, DeleteOldBakes=False, PreserveTrees=False)

# ----
# Glass Thickness
number_slider_6 = Slider(10, range=0..100)
subtraction_4 = Subtraction(A=number_slider_2, B=division_2)
subtraction_5 = Subtraction(A=number_slider_3, B=number_slider_5)
division_5 = Division(A=number_slider_6, B=2)
division_6 = Division(A=subtraction_5, B=2)
Z_4 = UnitZ(Factor=number_slider_3)
concat_5 = Concatenate(FragmentA=panel, FragmentB="Glass")
createatts_5 = CreateAttributes(LayerName=concat_5, GroupIndices=expr("x+2", addition), enableFullPath=True)

subtraction_6 = Subtraction(A=subtraction_4, B=division_5)

offset_2 = OffsetCurve(Curve=crv_2, Distance=subtraction_6, Plane=PlaneXY(0, 0, 0), Corners=1)
extr_3 = Extrude(Base=offset_2, Direction=Z_4)
offsrf_2 = OffsetSurface(Surface=extr_3, Distance=division_5, BothSides=True, CreateSolid=True)
bake_5 = BakeGeometry(Bake=button, Geometry=extr_3, Attributes=createatts_5, DeleteOldBakes=False, PreserveTrees=False)
