# Grasshopper definition 02_Stair Steps.gh (Grasshopper 1.0.7)
# plug-ins: Pufferfish, Human

# Step Height
# Step Count
# Bake
number_slider = Slider(5, range=0..10)
# Step Height
# Step Count
# Bake
number_slider_2 = Slider(19, range=0..20)
# Boundary
# Step Start
# Step Start Path
# Reverse
# Step Width
number_slider_3 = Slider(300, range=0..1000)
number_slider_4 = Slider(150, range=0..1000)
# Boundary
# Step Lines
# Step Line Guides
number_slider_5 = Slider(150, range=0..1000)
# Layer
panel = Panel("Massing Model::Stair")
# Layer
panel_2 = Panel("Steps")
# Step Line Extension
# Step Cutout Extension
crv = Curve(<curve referenced from the Rhino model>)
crv_2 = Curve(<curve referenced from the Rhino model>)
crv_3 = Curve(<curve referenced from the Rhino model>)
crv_4 = Curve([<curve referenced from the Rhino model> x12])
crv_5 = Curve(<curve referenced from the Rhino model>)
number_slider_6 = Slider(500, range=0..1000)
number_slider_7 = Slider(500, range=0..1000)

dispatch = Dispatch(List=crv_3, DispatchPattern=Toggle(True))  # -> ListA, ListB
flip = FlipCurve(Curve=dispatch.ListB)  # -> Curve, Flag
crv_6 = Curve([flip.Curve, dispatch.ListA])
x_minus_one = XMinusOne(NumberX=number_slider)
series = Series(Start=number_slider_3, Step=number_slider_3, Count=x_minus_one)  # -> graft(Series)
series_2 = Series(Start=number_slider_4, Step=number_slider_4, Count=x_minus_one)
neg = Negative(Value=series)
rev = ReverseList(List=series_2)
merge = Merge(Data1=series, Data2=neg)
offset = OffsetCurve(Curve=crv_6, Distance=merge, Plane=PlaneXY(0, 0, 0), Corners=1)  # -> simplify(Curve)
# Step Line Extension
# Step Cutout Extension
divide = DivideCurve(Curve=offset, Count=Slider(2, range=0..10), Kinks=False)  # -> simplify(Points), Tangents, Parameters
item = ListItem(List=divide.Points, Index=Slider(1, range=0..1), Wrap=True)
trim = TrimTree(Tree=item, Depth=1)
trim_2 = TrimTree(Tree=offset, Depth=1)
incurve = PointInCurve(Point=trim, Curve=crv_2)  # -> Relationship, Point
equals = Equality(FirstNumber=incurve.Relationship, SecondNumber=2)  # -> Equality, Inequality
dispatch_2 = Dispatch(List=trim_2, DispatchPattern=equals.Equality)  # -> flatten(ListA), ListB
ext = ExtendCurve(Curve=dispatch_2.ListA, Type=2, Start=number_slider_7, End=number_slider_7)
crv_7 = Curve(ext)
addition = Addition(A=flatten(series), B=Slider(900, range=0..1000))
flip_2 = FlipCurve(Curve=crv_7)  # -> Curve, Flag
multiplication = Multiplication(A=number_slider_4, B=number_slider)
Z = UnitZ(Factor=multiplication)
offcrv = OffsetCurve(Curve=flip_2.Curve, Distance=addition, Plane=PlaneXY(0, 0, 0), BothSides=False, Kinks=0, CapType=1)  # -> flatten(Offset)
extr = Extrude(Base=crv_2, Direction=Z)
Z_2 = UnitZ(Factor=rev)
move = Move(Geometry=offcrv, Motion=Z)  # -> Geometry, Transform
rev_2 = Reverse(Vector=Z_2)
extr_2 = Extrude(Base=move.Geometry, Direction=rev_2)
cap = CapHoles(Brep=extr_2)
sunion = SolidUnion(Breps=cap)
cap_2 = CapHoles(Brep=extr)
createatts = CreateAttributes(LayerName=panel_2, enableFullPath=True)
sdiff = SolidDifference(BrepsA=cap_2, BrepsB=sunion)
bake = BakeGeometry(Bake=Button(), Geometry=sdiff, Attributes=createatts, DeleteOldBakes=False, PreserveTrees=False)

x_minus_one_2 = XMinusOne(NumberX=number_slider_2)
series_3 = Series(Start=number_slider_5, Step=number_slider_5, Count=x_minus_one_2)
flip_3 = FlipCurve(Curve=crv_4, Guide=crv_5)  # -> Curve, Flag
addition_2 = Addition(B=Slider(1500, range=0..3000))
rev_3 = ReverseList(List=series_3)
multiplication_2 = Multiplication(A=number_slider_5, B=number_slider_2)
Z_3 = UnitZ(Factor=multiplication_2)
extr_3 = Extrude(Base=crv, Direction=Z_3)
Z_4 = UnitZ(Factor=rev_3)
rev_4 = Reverse(Vector=Z_4)
cap_3 = CapHoles(Brep=extr_3)
createatts_2 = CreateAttributes(LayerName=panel, enableFullPath=True)

ext_2 = ExtendCurve(Curve=flip_3.Curve, Type=2, Start=number_slider_6, End=number_slider_6)

offcrv_2 = OffsetCurve(Curve=ext_2, Distance=addition_2, Plane=PlaneXY(0, 0, 0), BothSides=False, Kinks=0, CapType=1)  # -> flatten(Offset)
move_2 = Move(Geometry=offcrv_2, Motion=Z_3)  # -> Geometry, Transform
extr_4 = Extrude(Base=move_2.Geometry, Direction=rev_4)
cap_4 = CapHoles(Brep=extr_4)
sunion_2 = SolidUnion(Breps=cap_4)
sdiff_2 = SolidDifference(BrepsA=cap_3, BrepsB=sunion_2)
bake_2 = BakeGeometry(Bake=Button(), Geometry=sdiff_2, Attributes=createatts_2, DeleteOldBakes=False, PreserveTrees=False)
