# Grasshopper definition 03_Spiral Stairs.gh (Grasshopper 1.0.7)
# plug-ins: Pufferfish

# 踏步高
number_slider = Slider(150, range=0..1000)
# 踏步数
number_slider_2 = Slider(19, range=0..25)
pt = Point(Point(0, 0, 0))
# 外径
number_slider_3 = Slider(3000, range=0..10000)
# 台阶宽度
number_slider_4 = Slider(2000, range=0..10000)
# 旋转角度
number_slider_5 = Slider(270, range=0..1000)
x_minus_one = XMinusOne(NumberX=number_slider_2)
rad = Radians(Degrees=number_slider_5)
subtraction = Subtraction(A=number_slider_3, B=number_slider_4)
arc = Arc(Plane=pt, Radius=[number_slider_3, subtraction], Angle=rad)  # -> Arc, Length
divide = DivideCurve(Curve=arc.Arc, Count=x_minus_one, Kinks=False)  # -> Points, Tangents, Parameters
item = ListItem(List=divide.Points, Index=1, Wrap=True)
item_2 = ListItem(List=divide.Points, Index=0, Wrap=True)
dist = Distance(PointA=item_2, PointB=item)
shatter = Shatter(Curve=graft(arc.Arc), Parameters=divide.Parameters)
panel = Panel(dist)
flip = FlipMatrix(Data=divide.Points)
Z = UnitZ(Factor=number_slider)
flip_2 = FlipMatrix(Data=shatter)
pline = PolyLine(Vertices=flip, Closed=False)
loft = Loft(Curves=flip_2, Options={Adjust=False, Closed=False, LoftEnds=0, LoftSimp=0, LoftType=0, Rebuild=10, Refit=0.01})
extr = Extrude(Base=pline, Direction=Z)
series = Series(Start=number_slider, Step=number_slider, Count=x_minus_one)
series_2 = Series(Start=0, Step=number_slider, Count=number_slider_2)
Z_2 = UnitZ(Factor=series)
Z_3 = UnitZ(Factor=series_2)
move = Move(Geometry=flatten(loft), Motion=Z_2)  # -> Geometry, Transform
move_2 = Move(Geometry=flatten(extr), Motion=Z_3)  # -> Geometry, Transform
