# Grasshopper definition 04_Typical Mullion_Curtain Wall Base Line.gh (Grasshopper 1.0.7)
# plug-ins: Pufferfish, Human

# Base Path
# Base Path Reverse
# Base Offset
# Bake
number_slider = Slider(20, range=0..100)
panel = Panel("""40
2500
5000
7500""")
# Layer
panel_2 = Panel("Facade::Curtain Wall::Mullion")
# Group Number Control
panel_3 = Panel("500")
button = Button()
crv = Curve(<curve referenced from the Rhino model>)
multiplication = Multiplication(A=Slider(3, range=0..99), B=10)
# Horizontal Height
# Horizontal Width
# Horizontal Thickness
addition = Addition(A=panel_3, B=multiplication)
# Vertical Thickness
# Vertical Width
# Vertical Distance
dispatch = Dispatch(List=crv, DispatchPattern=Toggle(True))  # -> ListA, ListB
flip = FlipCurve(Curve=dispatch.ListB)  # -> Curve, Flag
crv_2 = Curve([dispatch.ListA, flip.Curve])
offset = OffsetCurve(Curve=crv_2, Distance=number_slider, Plane=PlaneXY(0, 0, 0), Corners=1)

number_slider_2 = Slider(40, range=0..100)
number_slider_3 = Slider(1100, range=0..10000)
division = Division(A=Slider(80, range=0..100), B=2)
subtraction = Subtraction(A=panel, B=number_slider_2)
Z = UnitZ(Factor=subtraction)
move = Move(Geometry=offset, Motion=Z)  # -> Geometry, Transform
Z_2 = UnitZ(Factor=number_slider_2)
extr = Extrude(Base=move.Geometry, Direction=Z_2)
offsrf = OffsetSurface(Surface=extr, Distance=division, BothSides=True, CreateSolid=True)
concat = Concatenate(FragmentA=panel_2)
createatts = CreateAttributes(LayerName=concat, GroupIndices=expr("x+1", addition), enableFullPath=True)
bake = BakeGeometry(Bake=button, Geometry=offsrf, Attributes=createatts, DeleteOldBakes=False, PreserveTrees=False)

item = ListItem(List=panel, Index=-1, Wrap=True)

len = Length(Curve=offset)
division_2 = Division(A=len, B=Slider(4121, range=0..10000))
divide = DivideCurve(Curve=offset, Count=division_2, Kinks=False)  # -> Points, Tangents, Parameters
division_3 = Division(A=Slider(50, range=0..100), B=2)
division_4 = Division(A=Slider(80, range=0..100), B=2)
subtraction_2 = Subtraction(A=item, B=number_slider_2)
neg = Negative(Value=division_3)
neg_2 = Negative(Value=division_4)
hframe = HorizontalFrame(Curve=offset, Parameter=divide.Parameters)
dom = ConstructDomain(DomainStart=neg, DomainEnd=division_3)
dom_2 = ConstructDomain(DomainStart=neg_2, DomainEnd=division_4)
Z_3 = UnitZ(Factor=subtraction_2)
rectangle = Rectangle(Plane=hframe, XSize=dom, YSize=dom_2, Radius=0)  # -> Rectangle, Length
extr_2 = Extrude(Base=rectangle.Rectangle, Direction=Z_3)
cap = CapHoles(Brep=extr_2)
concat_2 = Concatenate(FragmentA=panel_2)
createatts_2 = CreateAttributes(LayerName=concat_2, GroupIndices=addition, enableFullPath=True)
bake_2 = BakeGeometry(Bake=button, Geometry=cap, Attributes=createatts_2, DeleteOldBakes=False, PreserveTrees=False)
