# Grasshopper definition 05_Perforated Panel.gh (Grasshopper 1.0.7)
# plug-ins: Pufferfish, EleFront, LunchBox

number_slider = Slider(199, range=0..1000)  # disabled
number_slider_2 = Slider(100, range=0..100)  # disabled
number_slider_3 = Slider(17, range=0..100)  # disabled
number_slider_4 = Slider(20, range=0..100)  # disabled
number_slider_5 = Slider(50, range=0..1000)  # disabled
pt = Point(<point referenced from the Rhino model>)  # disabled
pt_2 = Point(<point referenced from the Rhino model>)
sqgrid = Square(Plane=pt, Size=number_slider_5, ExtentX=number_slider_2, ExtentY=number_slider_3)  # -> Cells, flatten(Points); disabled
trigrid = Triangular(Plane=pt, Size=number_slider_5, ExtentX=number_slider, ExtentY=number_slider_4)  # -> Cells, flatten(Points); disabled
trigrid_2 = Triangular(Plane=pt_2, Size=Slider(100, range=0..1000), ExtentX=Slider(450, range=0..1000), ExtentY=Slider(230, range=0..1000))  # -> Cells, flatten(Points)
explode = Explode(Curve=trigrid.Cells, Recursive=True)  # -> Segments, Vertices; disabled
explode_2 = Explode(Curve=trigrid_2.Cells, Recursive=True)  # -> Segments, Vertices
cullpt = CullDuplicates(Points=flatten(explode.Vertices), Tolerance=0.1, CullMode=1)  # -> Points, Indices, Valence; disabled
cullpt_2 = CullDuplicates(Points=flatten(explode_2.Vertices), Tolerance=0.1, CullMode=1)  # -> Points, Indices, Valence
crv = Curve(<curve referenced from the Rhino model>)  # disabled
crv_2 = Curve(<curve referenced from the Rhino model>)  # disabled
crv_3 = Curve(<curve referenced from the Rhino model>)
crv_4 = Curve(<curve referenced from the Rhino model>)
offcrv = OffsetCurve(Curve=crv_3, Distance=Slider(100, range=0..1000), Plane=PlaneXY(0, 0, 0), BothSides=True, Kinks=0, CapType=0)
offcrv_2 = OffsetCurve(Curve=crv_4, Distance=Slider(100, range=0..1000), Plane=PlaneXY(0, 0, 0), BothSides=True, Kinks=0, CapType=0)
crv_cp = CurveClosestPoint(Point=cullpt.Points, Curve=crv_2)  # -> Point, Parameter, Distance; disabled
len = Length(Curve=offcrv)
len_2 = Length(Curve=offcrv_2)
crv_5 = Curve(<curve referenced from the Rhino model>)
crv_6 = Curve(<curve referenced from the Rhino model>)
sort = SortList(Keys=len, ValuesA=offcrv)  # -> Keys, ValuesA
sort_2 = SortList(Keys=len_2, ValuesA=offcrv_2)  # -> Keys, ValuesA
item = ListItem(List=sort.ValuesA, Index=Slider(0, range=0..1), Wrap=True)  # -> flatten(Item)
incurve = PointInCurve(Point=cullpt_2.Points, Curve=item)  # -> Relationship, Point
equals = Equality(FirstNumber=incurve.Relationship, SecondNumber=2)  # -> Equality, Inequality
dispatch = Dispatch(List=cullpt_2.Points, DispatchPattern=equals.Equality)  # -> ListA, ListB
item_2 = ListItem(List=sort_2.ValuesA, Index=Slider(1, range=0..1), Wrap=True)  # -> flatten(Item)
incurve_2 = PointInCurve(Point=dispatch.ListA, Curve=item_2)  # -> Relationship, Point
number_slider_6 = Slider(850, range=0..1000)  # disabled
equals_2 = Equality(FirstNumber=incurve_2.Relationship, SecondNumber=0)  # -> Equality, Inequality
number_slider_7 = Slider(900, range=0..1000)  # disabled
lng = ListLength(List=cullpt.Points)  # disabled
dispatch_2 = Dispatch(List=dispatch.ListA, DispatchPattern=equals_2.Equality)  # -> ListA, ListB
random = Random(Range=number_slider_6, Number=lng, Seed=2)  # disabled
addition = Addition(A=crv_cp.Distance, B=random)  # disabled
crv_cp_2 = CurveClosestPoint(Point=dispatch_2.ListA, Curve=crv_5)  # -> Point, Parameter, Distance
crv_cp_3 = CurveClosestPoint(Point=dispatch_2.ListA, Curve=crv_6)  # -> Point, Parameter, Distance
larger = LargerThan(FirstNumber=addition, SecondNumber=number_slider_7)  # -> LargerThan, OrEqualTo; disabled
addition_2 = Addition(A=crv_cp_2.Distance, B=crv_cp_3.Distance)
number_slider_8 = Slider(0.4, range=0..1)  # disabled
dispatch_3 = Dispatch(List=cullpt.Points, DispatchPattern=larger.LargerThan)  # -> ListA, ListB; disabled
division = Division(A=crv_cp_2.Distance, B=addition_2)
lng_2 = ListLength(List=cullpt_2.Points)
pt_3 = Point(dispatch_3.ListB)  # disabled
random_2 = Random(Range=Slider(0.5, range=0..1), Number=lng_2, Seed=2)
number_slider_9 = Slider(10, range=0..100)  # disabled
addition_3 = Addition(A=division, B=random_2)
number_slider_10 = Slider(15, range=0..100)  # disabled
randomsplit = RandomSplitList(MasterList=pt_3, Seed=2, Split=number_slider_8)  # -> ListA, ListB; disabled
larger_2 = LargerThan(FirstNumber=addition_3, SecondNumber=Slider(0.6, range=0..10))  # -> LargerThan, OrEqualTo
cir = Circle(Plane=randomsplit.ListB, Radius=number_slider_9)  # disabled
cir_2 = Circle(Plane=randomsplit.ListA, Radius=number_slider_10)  # disabled
dispatch_4 = Dispatch(List=dispatch_2.ListA, DispatchPattern=larger_2.LargerThan)  # -> ListA, ListB
boundary = BoundarySurfaces(Edges=cir_2)  # disabled
boundary_2 = BoundarySurfaces(Edges=cir)  # disabled
pt_4 = Point(dispatch_4.ListB)
randomsplit_2 = RandomSplitList(MasterList=pt_4, Seed=2, Split=Slider(0.4, range=0..1))  # -> ListA, ListB
cir_3 = Circle(Plane=PlaneXY(0, 0, 0), Radius=Slider(15, range=0..100))
cir_4 = Circle(Plane=PlaneXY(0, 0, 0), Radius=Slider(10, range=0..100))
boundary_3 = BoundarySurfaces(Edges=cir_4)
boundary_4 = BoundarySurfaces(Edges=cir_3)
block = DefineBlock(Geometry=boundary_4, BlockName="Large Hole", BasePlane=PlaneXY(0, 0, 0))
pt_5 = ConstructPoint(XCoordinate=0, YCoordinate=0, ZCoordinate=0)
block_2 = DefineBlock(Geometry=boundary_3, BlockName="Small Hole", BasePlane=PlaneXY(0, 0, 0))
move2pt = MoveToPoint(Geometry=block, PointA=pt_5, PointB=randomsplit_2.ListA)  # -> Moved, Vector, Transform
move2pt_2 = MoveToPoint(Geometry=block_2, PointA=pt_5, PointB=randomsplit_2.ListB)  # -> Moved, Vector, Transform
