# Grasshopper definition Layer Materials.gh (Grasshopper 1.0.7)

assignlayermaterial = CSharpScript(activate=Button(), randomLayerColor=Toggle(False), followLayerColor=Toggle(False))  # -> out; inputs activate: Boolean, randomLayerColor: Boolean, followLayerColor: Boolean
# ---------- assignlayermaterial: C# usings ----------
using Rhino.DocObjects;
using System.Drawing;
using Rhino.Render;
# ---------- assignlayermaterial: C# ----------
    System.Array colorsArray = Enum.GetValues(typeof(KnownColor));
    KnownColor[] allColors = new KnownColor[colorsArray.Length];

    Array.Copy(colorsArray, allColors, colorsArray.Length);

    if (activate){
      RhinoDoc doc = RhinoDoc.ActiveDoc;
      for(int i = 0;i < doc.Layers.Count;i++){
        Layer layer = doc.Layers[i];
        if(layer.IsValid){
          if(randomLayerColor){
            if(layer.Color == Color.Black){
              currentColorIndex = colorIndex.Count;
              Print("So dull...Changing the color to " + currentColorIndex.ToString()
                + " " + allColors[currentColorIndex].ToString());
              layer.Color = Color.FromKnownColor(allColors[currentColorIndex]);
              colorIndex.Add(currentColorIndex);
              currentColorIndex++;
            }
          }
          
          if(layer.RenderMaterialIndex == -1){
            Print("Creating new material for " + layer.FullPath);
            Material newMat = new Material();
            newMat.Name = layer.FullPath;
            if(followLayerColor){
              newMat.DiffuseColor = layer.Color;
            }
            else{
              newMat.DiffuseColor = Color.White;
            }

            RenderMaterial newRenderMat = RenderMaterial.CreateBasicMaterial(newMat, doc);
            newRenderMat.Name = layer.FullPath;
            layer.RenderMaterial = newRenderMat;
          }
        }
      }

    }
# ---------- assignlayermaterial: C# additional code ----------
  private int currentColorIndex = 0;
  private List<int> colorIndex = new List<int>();
# ---------- end assignlayermaterial ----------
panel = Panel(assignlayermaterial)
